# Dynamo graph 01_ProjectInformation.dyn (Dynamo 2.3.1.11775)

# group: PROJECT INFORMATION
# note: This Python Script retrieves
# all the Project Information
# Parameters
python_script = Python()
# ---------- python_script.python (22 lines) ----------
import clr

clr.AddReference("RevitNodes")
import Revit
clr.ImportExtensions(Revit.Elements)

clr.AddReference("RevitServices")
import RevitServices
from RevitServices.Persistence import DocumentManager
doc = DocumentManager.Instance.CurrentDBDocument

clr.AddReference("RevitAPI")
import Autodesk
from Autodesk.Revit.DB import *

doc = DocumentManager.Instance.CurrentDBDocument
project_info = FilteredElementCollector(doc).OfCategory(BuiltInCategory.OST_ProjectInformation).ToElements()[0]
project_info_parameters = project_info.Parameters
output_list = []
for parameter in project_info_parameters:
    output_list.append([parameter.Definition.Name, parameter.AsString()])
OUT = output_list
# ----------------------------------------
list_create = List.Create(item0=python_script)
code_block = CodeBlock { 1; }
getItemAtIndex = List.GetItemAtIndex(list=list_create@L2, index=code_block)
# note: Enter the Indexes for
# the Project Name
# and the Project Number
code_block_2 = CodeBlock { 14; 8; }
# note: Project Name
getItemAtIndex_2 = List.GetItemAtIndex(list=getItemAtIndex, index=code_block_2.out0)
# note: Project Number
getItemAtIndex_3 = List.GetItemAtIndex(list=getItemAtIndex, index=code_block_2.out1)
