# Dynamo graph 03_ModelAndDetailGroups.dyn "03_Model and Detail Groups" (Dynamo 2.3.1.11775)

# group: Model Groups
element_types = ElementTypes("Group")  # graph input
all_elements_of_type = ElementsOfType(element_type=element_types)
getCategory = Element.GetCategory(element=all_elements_of_type)
string_from_object = FromObject(obj=getCategory)
code_block = CodeBlock { "Model"; }
startsWith = String.StartsWith(str=string_from_object, searchFor=code_block)
filterByBoolMask = List.FilterByBoolMask(list=string_from_object, mask=startsWith)
count = List.Count(list=filterByBoolMask.in)

# group: Detail Groups
element_types_2 = ElementTypes("Group")  # graph input
all_elements_of_type_2 = ElementsOfType(element_type=element_types_2)
getCategory_2 = Element.GetCategory(element=all_elements_of_type_2)
string_from_object_2 = FromObject(object=getCategory_2)
code_block_2 = CodeBlock { "Detail"; }
startsWith_2 = String.StartsWith(str=string_from_object_2, searchFor=code_block_2)
filterByBoolMask_2 = List.FilterByBoolMask(list=string_from_object_2, mask=startsWith_2)
count_2 = List.Count(list=filterByBoolMask_2.in)
