# Dynamo graph 05_LinksAndImports.dyn "05_Links and Imports" (Dynamo 2.3.1.11775)
# packages: Bakery 2019.5.8

# group: CAD Links and Imports
# note: Custom Node: Clockwork v.1.0.3
linksAndImports = Custom[Document.LinksAndImports]()  # Gets all linked and imported files in the document. NOTE: Does *not* retrieve linked Revit files.
count = List.Count(list=linksAndImports.links)
count_2 = List.Count(list=linksAndImports.imports)

# group: Revit Links
# note: Custom Node: Bakery v.2019.5.8
get_linked_rvt_documents = Custom[Get Linked RVT Documents]()  # package Bakery
count_3 = List.Count(list=get_linked_rvt_documents.Link_Doc)
