# Dynamo graph 06_PurgeableElements.dyn "06_Purgeable Elements" (Dynamo 2.3.1.11775)
# packages: Modelical 2.2.19

# group: View Templates
boolean = BoolSelector(false)
# note: Custom Node: Modelical v.2.2.19
deleteUnusedViewTemplates = Custom[DeleteUnusedViewTemplates](Toggle=boolean)  # package Modelical; Delete all unused ViewTemplates in your file, except for 3D view templates, as they cannot be converted to work with Dynamo yet.
count = List.Count(list=deleteUnusedViewTemplates)

# group: Filters
boolean_2 = BoolSelector(false)
# note: Custom Node: Modelical v.2.2.19
deleteUnusedFilters = Custom[DeleteUnusedFilters](Toggle=boolean_2)  # package Modelical; Delete all unused filters in your project file
count_2 = List.Count(list=deleteUnusedFilters)

# group: Line Patterns
boolean_3 = BoolSelector(false)
# note: Custom Node: Modelical v.2.2.19
deleteLinePatterns = Custom[DeleteLinePatterns](Toggle=boolean_3)  # package Modelical; Delete all the imported Line Patterns from CAD files.
count_3 = List.Count(list=deleteLinePatterns)
