# Dynamo graph 08_PlacedElements.dyn (Dynamo 2.3.1.11775)
# packages: Bakery 2019.5.8

# group: Placed Elements
# note: Custom Node: Bakery v.2019.5.8
collect_all_elements_in_model = Custom[Collect All Elements in Model]()  # package Bakery
count = List.Count(list=collect_all_elements_in_model.elements)
code_block = CodeBlock { "Category"; }
getParameterValueByName = Element.GetParameterValueByName(element=collect_all_elements_in_model.elements, parameterName=code_block)
identity = Object.Identity()  # unwired: obj
groupByFunction = List.GroupByFunction(list=getParameterValueByName, func=identity)
firstItem = List.FirstItem(list=groupByFunction@L2, lacing=Longest)
count_2 = List.Count(list=groupByFunction@L2, lacing=Longest)
