# Dynamo graph 09_Warnings.dyn (Dynamo 2.3.1.11775)
# packages: spring nodes 204.1.0, archi-lab.net 2020.23.2, Clockwork for Dynamo 1.x 1.0.3

# group: Export File (Blank Excel)
file_path = Filename("..\Internal\Warnings by Level.xlsx")  # graph input

# group: Get Warnings
# note: Custom Node: archilab v.2020.23.2
getWarnings = archilab.Revit.Elements.Warning.GetWarnings()

# group: Isolate Elements and their IDs
# note: Custom Node: archilab v.2020.23.2
# note: Warnings
elements = archilab.Revit.Elements.Warning.Elements(warning=getWarnings)
code_block = CodeBlock { 1; }
takeItems = List.TakeItems(list=elements@L2, amount=code_block)
id = archilab.Revit.Elements.WarningElement.Id(warningElement=takeItems)
code_block_2 = CodeBlock { 1; }
flatten = List.Flatten(list=id, amt=code_block_2)
# note: Element
byElementId = archilab.Revit.Selection.Select.ByElementId(id=flatten)

# group: Get Level Name for the Elements
# note: Custom Node: Clockwork v.1.0.3
# note: Element
level = Custom[Element.Level](element=byElementId)  # package Clockwork for Dynamo 1.x
boolean = BoolSelector(false)
clean = List.Clean(list=level, preserveIndices=boolean)
uniqueItems = List.UniqueItems(list=clean)
elevation = Level.Elevation(level=uniqueItems)
# note: string
sort = List.Sort(list=elevation)
# note: Custom Node: spring nodes v.204.1.0
# note: list
# note: double
# note: newList
ꟿ_list_nullallindicesof = Custom[ꟿ List.NullAllIndicesOf](list=elevation, value=sort)  # package spring nodes; list all of the indices of a list that match the specified value. Capable of handling null values, part of the SmartCopyMonitor workflow.
getItemAtIndex = List.GetItemAtIndex(list=uniqueItems, index=ꟿ_list_nullallindicesof)
code_block_3 = CodeBlock { 1; }
flatten_2 = List.Flatten(list=getItemAtIndex, amt=code_block_3)
name = Level.Name(level=flatten_2)
# note: Category
name_2 = Level.Name(level=clean)

# group: Get the Warning Error Message
# note: Custom Node: archilab v.2020.23.2
# note: string
errorMessage = archilab.Revit.Elements.Warning.ErrorMessage(warning=getWarnings)

# group: Assign Severity Rating from Central Warning Database
file_path_2 = Filename("..\Internal\CentralWarningDatabase.csv")  # graph input
# note: Custom Node: archilab v.2020.23.2
warningLibraryFromCsv = archilab.Revit.Elements.WarningLibrary.WarningLibraryFromCsv(filePath=file_path_2)
assignRating = archilab.Revit.Elements.Warning.AssignRating(warning=getWarnings, library=warningLibraryFromCsv)
# note: int
rating = archilab.Revit.Elements.Warning.Rating(warning=assignRating)

# group: Get the Elements Category
# note: Element
getCategory = Element.GetCategory(element=byElementId)

# group: List Management
# note: Custom Node: spring nodes v.204.1.0
# note: string
ꟿ_list_nullallindicesof_2 = Custom[ꟿ List.NullAllIndicesOf](list=name_2, value=name)
# note: LEVEL
getItemAtIndex_2 = List.GetItemAtIndex(list=name_2, index=ꟿ_list_nullallindicesof_2)
# note: WARNINGS
getItemAtIndex_3 = List.GetItemAtIndex(list=errorMessage, index=ꟿ_list_nullallindicesof_2)
# note: ELEMENTS
# note: Element
getItemAtIndex_4 = List.GetItemAtIndex(list=byElementId, index=ꟿ_list_nullallindicesof_2)
# note: SEVERITY
# note: int
getItemAtIndex_5 = List.GetItemAtIndex(list=rating, index=ꟿ_list_nullallindicesof_2)
# note: CATEGORY
# note: Category
getItemAtIndex_6 = List.GetItemAtIndex(list=getCategory, index=ꟿ_list_nullallindicesof_2)
list_create = List.Create(item0=getItemAtIndex_2, item1=getItemAtIndex_3, item2=getItemAtIndex_4, item3=getItemAtIndex_5, item4=getItemAtIndex_6)
# note: list
transpose = List.Transpose(lists=list_create)
transpose_2 = List.Transpose()  # unwired: lists

# group: Add Header to List
# note: string
map = List.Map(list=transpose, f_x=transpose_2)
code_block_4 = CodeBlock()
# ---------- code_block_4.designscript (5 lines) ----------
["LEVEL",
"WARNINGS",
"ELEMENTS",
"SEVERITY",
"CATEGORY"];
# ----------------------------------------
addItemToFront = List.AddItemToFront(item=code_block_4)  # unwired: list
# note: mapped
map_2 = List.Map(list=map, f_x=addItemToFront)

# group: Write to Excel
# note: string
code_block_5 = CodeBlock { 0; 0; "True"; }
# note: Export Warnings by Level
# to SEPARATE Excel Sheets
exportExcel = Data.ExportExcel(filePath=file_path, sheetName=name, startRow=code_block_5.out0, startCol=code_block_5.out1, data=map_2, overWrite=code_block_5.out2)  # graph output

# group: Export File (Blank Excel) - Optional
file_path_3 = Filename("..\Internal\Warnings Overview.xlsx")  # graph input

# group: List Management - Optional
code_block_6 = CodeBlock { 1; }
flatten_3 = List.Flatten(list=map, amt=code_block_6)
addItemToFront_2 = List.AddItemToFront(item=code_block_4, list=flatten_3)

# group: Write to Excel - Optional
code_block_7 = CodeBlock { "Overview"; 0; 0; "True"; }
# note: Export Warnings by Level
# to a SINGLE Excel Sheet
exportExcel_2 = Data.ExportExcel(filePath=file_path_3, sheetName=code_block_7.out0, startRow=code_block_7.out1, startCol=code_block_7.out2, data=addItemToFront_2, overWrite=code_block_7.out3)  # graph output
