# Dynamo graph 10_RevitModelCheck.dyn (Dynamo 2.3.1.11775)
# packages: Bakery 2019.5.8, Modelical 2.2.19, spring nodes 110.0.2, archi-lab.net 2020.23.2

# group: FILE INFORMATION
# note: Custom Node: Clockwork v.1.0.3
version = Custom[Application.Version]()  # Retrieves the name, version and build of the current Revit application.
watch = Watch(version.Build)
watch_2 = Watch(version.Name)
current = Document.Current()
filePath = Document.FilePath(document=current)
# note: Custom Node: spring nodes v.204.1.0
size = Custom[Springs.File.Size](path=filePath)  # package spring nodes; Outputs the the file size in kilobytes or megabytes. Provide a file path as a string. Set kbOnly to true for a consistent output.
code_block = CodeBlock { 0; }
getItemAtIndex = List.GetItemAtIndex(list=size, index=code_block)
watch_3 = Watch(getItemAtIndex)
watch_4 = Watch(version.Version_int)
watch_5 = Watch(version.Language)

# group: PROJECT INFORMATION
# note: This Python Script retrieves
# all the Project Information
# Parameters
python_script = Python()
# ---------- python_script.python (22 lines) ----------
import clr

clr.AddReference("RevitNodes")
import Revit
clr.ImportExtensions(Revit.Elements)

clr.AddReference("RevitServices")
import RevitServices
from RevitServices.Persistence import DocumentManager
doc = DocumentManager.Instance.CurrentDBDocument

clr.AddReference("RevitAPI")
import Autodesk
from Autodesk.Revit.DB import *

doc = DocumentManager.Instance.CurrentDBDocument
project_info = FilteredElementCollector(doc).OfCategory(BuiltInCategory.OST_ProjectInformation).ToElements()[0]
project_info_parameters = project_info.Parameters
output_list = []
for parameter in project_info_parameters:
    output_list.append([parameter.Definition.Name, parameter.AsString()])
OUT = output_list
# ----------------------------------------
list_create = List.Create(item0=python_script)
code_block_2 = CodeBlock { 1; }
getItemAtIndex_2 = List.GetItemAtIndex(list=list_create@L2, index=code_block_2)
# note: Enter the Indexes for
# the Project Name and
# the Project Number
code_block_3 = CodeBlock { 14; 8; }
# note: Project Name
getItemAtIndex_3 = List.GetItemAtIndex(list=getItemAtIndex_2, index=code_block_3.out0)
watch_6 = Watch(getItemAtIndex_3)
# note: Project Number
getItemAtIndex_4 = List.GetItemAtIndex(list=getItemAtIndex_2, index=code_block_3.out1)
watch_7 = Watch(getItemAtIndex_4)

# group: MODEL AND DETAIL GROUPS
element_types = ElementTypes("Group")
all_elements_of_type = ElementsOfType(element_type=element_types)
getCategory = Element.GetCategory(element=all_elements_of_type)
string_from_object = FromObject(obj=getCategory)
code_block_4 = CodeBlock { "Model"; }
startsWith = String.StartsWith(str=string_from_object, searchFor=code_block_4)
filterByBoolMask = List.FilterByBoolMask(list=string_from_object, mask=startsWith)
count = List.Count(list=filterByBoolMask.in)
watch_8 = Watch(count)
element_types_2 = ElementTypes("Group")
all_elements_of_type_2 = ElementsOfType(element_type=element_types_2)
getCategory_2 = Element.GetCategory(element=all_elements_of_type_2)
string_from_object_2 = FromObject(obj=getCategory_2)
code_block_5 = CodeBlock { "Detail"; }
startsWith_2 = String.StartsWith(str=string_from_object_2, searchFor=code_block_5)
filterByBoolMask_2 = List.FilterByBoolMask(list=string_from_object_2, mask=startsWith_2)
count_2 = List.Count(list=filterByBoolMask_2.in)
watch_9 = Watch(count_2)

# group: IN-PLACE FAMILIES AND GENERIC MODELS
# note: Custom Node: Bakery v.2019.5.8
report_on_inplace_families = Custom[Report on Inplace Families]()  # package Bakery
count_3 = List.Count(list=report_on_inplace_families.inplace_families)
watch_10 = Watch(count_3)
categories = Categories("OST_GenericModel")
all_elements_of_category = ElementsOfCategory(Category=categories)
count_4 = List.Count(list=all_elements_of_category)
watch_11 = Watch(count_4)

# group: LINKS AND IMPORTS
# note: Custom Node: Bakery v.2019.5.8
get_linked_rvt_documents = Custom[Get Linked RVT Documents]()  # package Bakery
count_5 = List.Count(list=get_linked_rvt_documents.Link_Doc)
watch_12 = Watch(count_5)
# note: Custom Node: Clockwork v.1.0.3
linksAndImports = Custom[Document.LinksAndImports]()  # Gets all linked and imported files in the document. NOTE: Does *not* retrieve linked Revit files.
count_6 = List.Count(list=linksAndImports.links)
watch_13 = Watch(count_6)
count_7 = List.Count(list=linksAndImports.imports)
watch_14 = Watch(count_7)

# group: PURGEABLE ELEMENTS
boolean = BoolSelector(false)
# note: Custom Node: Modelical v.2.2.19
deleteUnusedViewTemplates = Custom[DeleteUnusedViewTemplates](Toggle=boolean)  # package Modelical; Delete all unused ViewTemplates in your file, except for 3D view templates, as they cannot be converted to work with Dynamo yet.
count_8 = List.Count(list=deleteUnusedViewTemplates)
watch_15 = Watch(count_8)
boolean_2 = BoolSelector(false)
deleteUnusedFilters = Custom[DeleteUnusedFilters](Toggle=boolean_2)  # package Modelical; Delete all unused filters in your project file
count_9 = List.Count(list=deleteUnusedFilters)
watch_16 = Watch(count_9)
boolean_3 = BoolSelector(false)
deleteLinePatterns = Custom[DeleteLinePatterns](Toggle=boolean_3)  # package Modelical; Delete all the imported Line Patterns from CAD files.
count_10 = List.Count(list=deleteLinePatterns)
watch_17 = Watch(count_10)

# group: VIEWS
categories_2 = Categories("OST_Views")
all_elements_of_category_2 = ElementsOfCategory(Category=categories_2)
isNull = Object.IsNull(obj=all_elements_of_category_2)
filterByBoolMask_3 = List.FilterByBoolMask(list=all_elements_of_category_2, mask=isNull)
# note: Views Count
count_11 = List.Count(list=filterByBoolMask_3.out)
watch_18 = Watch(count_11)
categories_3 = Categories("OST_Views")
all_elements_of_category_3 = ElementsOfCategory(Category=categories_3)
isNull_2 = Object.IsNull(obj=all_elements_of_category_3)
filterByBoolMask_4 = List.FilterByBoolMask(list=all_elements_of_category_3, mask=isNull_2)
code_block_6 = CodeBlock { "Sheet Number"; }
getParameterValueByName = Element.GetParameterValueByName(element=filterByBoolMask_4.out, parameterName=code_block_6)
code_block_7 = CodeBlock { "---"; }
eq = getParameterValueByName == code_block_7
filterByBoolMask_5 = List.FilterByBoolMask(list=getParameterValueByName, mask=eq)
# note: Views not Placed on Sheets
count_12 = List.Count(list=filterByBoolMask_5.in)
watch_19 = Watch(count_12)

# group: PLACED ELEMENTS
# note: Custom Node: Bakery v.2019.5.8
collect_all_elements_in_model = Custom[Collect All Elements in Model]()  # package Bakery
count_13 = List.Count(list=collect_all_elements_in_model.elements)
watch_20 = Watch(count_13)

# group: WARNINGS
# note: Custom Node: archilab v.2020.23.2
getWarnings = archilab.Revit.Elements.Warning.GetWarnings()
count_14 = List.Count(list=getWarnings)
watch_21 = Watch(count_14)

# group: WRITE TO EXCEL
file_path = Filename("..\..\..\..\Revit Model Check.xlsx")  # graph input
code_block_8 = CodeBlock { "Model Check"; 0; 0; "True"; }
code_block_9 = CodeBlock()
# ---------- code_block_9.designscript (18 lines) ----------
["Project Name",
"Project Number",
"File Size",
"File Version",
"Model Groups",
"Detail Groups",
"In-Place Families",
"Generic Models",
"Revit Links",
"CAD Links",
"CAD imports",
"Unused View Templates",
"Unused Filters",
"UnusedLine Patterns",
"Views",
"Views not on Sheets",
"Placed Elements",
"Warnings"];
# ----------------------------------------
list_create_2 = List.Create(item0=watch_6, item1=watch_7, item2=watch_3, item3=watch_4, item4=watch_8, item5=watch_9, item6=watch_10, item7=watch_11, item8=watch_12, item9=watch_13, item10=watch_14, item11=watch_15, item12=watch_16, item13=watch_17, item14=watch_18, item15=watch_19, item16=watch_20, item17=watch_21)
list_create_3 = List.Create(item0=code_block_9, item1=list_create_2)
exportExcel = Data.ExportExcel(filePath=file_path, sheetName=code_block_8.out0, startRow=code_block_8.out1, startCol=code_block_8.out2, data=list_create_3, overWrite=code_block_8.out3)  # graph output
watch_22 = Watch(exportExcel)
